# Grasshopper definition SrfToGrid.gh (Grasshopper 0.9.76)

srf = Surface(<surface referenced from the Rhino model>)
srf_2 = Surface(<surface referenced from the Rhino model>)
srf_3 = Surface(<surface referenced from the Rhino model>)
srf_4 = Surface(<surface referenced from the Rhino model>)
genysis_surface_exporter = GENYSISSURFACEEXPORTER(S_2=srf_2, S_4=srf, S_3=srf_4, S=srf_3, filepath="C:\Users\Fransic\Desktop\in.json")  # -> out, R
panel = Panel(genysis_surface_exporter.out)
pt = Point(genysis_surface_exporter.R)

# ==== cluster GENYSISSURFACEEXPORTER
num = Number(Slider(10, range=0..10))
num_2 = Number(Slider(46, range=0..100))
num_3 = Number(Slider(40, range=0..100))
S = ClusterInput()
S_2 = ClusterInput()
S_3 = ClusterInput()
S_4 = ClusterInput()
sframes = SurfaceFrames(Surface=S, UCount=num_2, VCount=num_3)  # -> Frames, Parameters
sframes_2 = SurfaceFrames(Surface=S_2, UCount=num, VCount=num_2)  # -> Frames, Parameters
sframes_3 = SurfaceFrames(Surface=S_3, UCount=num_2, VCount=num_3)  # -> Frames, Parameters
sframes_4 = SurfaceFrames(Surface=S_4, UCount=num, VCount=num_2)  # -> Frames, Parameters
pt = Point(sframes_2.Frames)
pt_2 = Point(sframes_4.Frames)
pt_3 = Point(sframes_3.Frames)
pt_4 = Point(sframes.Frames)
flip = FlipMatrix(Data=pt)
flip_2 = FlipMatrix(Data=pt_2)
filepath = ClusterInput()
merge = Merge(Data1=flip, Data2=flip_2, Data3=pt_3, Data4=pt_4)
python = PythonScript(pts1=flip, pts2=flip_2, pts3=pt_3, pts4=pt_4, filePath=filepath)  # -> out, a; inputs pts1: tree of Vector3d, pts2: tree of Vector3d, pts3: tree of Vector3d, pts4: tree of Vector3d
# ---------- python: Python ----------
surface1 = []
for l in range(0,pts1.BranchCount):
    row = pts1.Branch(l)
    newRow = []
    for p in row:
        newRow.append([p[0],p[1],p[2]])
    surface1.append(newRow)


surface2 = []
for l in range(0,pts2.BranchCount):
    row = pts2.Branch(l)
    newRow = []
    for p in row:
        newRow.append([p[0],p[1],p[2]])
    surface2.append(newRow)


surface3 = []
for l in range(0,pts3.BranchCount):
    row = pts3.Branch(l)
    newRow = []
    for p in row:
        newRow.append([p[0],p[1],p[2]])
    surface3.append(newRow)


surface4 = []
for l in range(0,pts4.BranchCount):
    row = pts4.Branch(l)
    newRow = []
    for p in row:
        newRow.append([p[0],p[1],p[2]])
    surface4.append(newRow)

final = [surface1,surface2,surface3,surface4]

print('saving at')
print(filePath)

if filePath is not '':
  f= open(filePath,"w")
  f.write(str(final))
  f.close()
  print('worked!')
# ---------- end python ----------
R = ClusterOutput(merge)
out = ClusterOutput(python.out)
